# Grasshopper definition 260209_D2P_CorePy_DevelopmentFile.gh (Grasshopper 1.0.8)
# Copyright: 2025

# __DEVELOPMENT_CREDITS__: Authors: Max Benjamin Eschenbach
# 
# Digital Design Unit (DDU)
# Prof. Dr.-Ing. Oliver Tessmann
# Fachbereich Architektur
# Technical University of Darmstadt
# 
# CREDITS:
# ------------
# ENVIRONMENT SPEC: #! python3
# # -*- coding: utf-8 -*-
# # venv: D2P_DEV
# print('ENV OK!')
box = CenterBox(Base=PlaneXY(0, 0, 0), X=1, Y=1, Z=1)
pln = Plane(PlaneXY(0, 0, 0))
py3sdkc = Py3SDKComponent(Pln=pln, Members=box)  # -> out, WrappedComp, NetComp; inputs Members: list of GeometryBase
# ---------- py3sdkc: Python ----------
#! python3
# -*- coding: utf-8 -*-
# venv: D2P_DEV
print('ENV OK!')
import d2p_core as d2p

# PYTHON STANDARD LIBRARY IMPORTS ---------------------------------------------

# RHINO AND GH RELATED IMPORTS ------------------------------------------------
import System  # type: ignore[reportMissingImport] # NOQA
import Grasshopper  # type: ignore[reportMissingImport] # NOQA
import Rhino  # type: ignore[reportMissingImport] # NOQA
import scriptcontext as sc  # type: ignore[reportMissingImport] # NOQA

# GHENV COMPONENT SETTINGS ----------------------------------------------------
ghenv.Component.Name = 'Py3SDKComponent'  # type: ignore[reportUnedfinedVariable] # NOQA
ghenv.Component.NickName = 'Py3SDKC'  # type: ignore[reportUnedfinedVariable] # NOQA
ghenv.Component.Category = 'Maths'  # type: ignore[reportUnedfinedVariable] # NOQA
ghenv.Component.SubCategory = 'Script'  # type: ignore[reportUnedfinedVariable] # NOQA
ghenv.Component.Description = (  # type: ignore[reportUnedfinedVariable] # NOQA
    'This is a Python3 SDK Scriptable Component.'
)


class Py3SDKComponent(Grasshopper.Kernel.GH_ScriptInstance):
    """
    Author: Max Benjamin Eschenbach
    License: MIT License
    Version: 251023.1
    """

    def __init__(self):
        """Initialize this component and set component parameters."""
        super().__init__()
        # initialize props
        self.Component = ghenv.Component  # type: ignore[reportUnedfinedVariable] # NOQA
        self.InputParams = self.Component.Params.Input
        self.OutputParams = self.Component.Params.Output

    def _addRemark(self, msg: str = ''):
        """Add a remark message to the component."""
        rml = self.Component.RuntimeMessageLevel.Remark
        self.AddRuntimeMessage(rml, msg)

    def _addWarning(self, msg: str = ''):
        """Add a warning message to the component."""
        rml = self.Component.RuntimeMessageLevel.Warning
        self.AddRuntimeMessage(rml, msg)

    def _addError(self, msg: str = ''):
        """Add an error message to the component."""
        rml = self.Component.RuntimeMessageLevel.Error
        self.AddRuntimeMessage(rml, msg)
    
    def BeforeRunScript(self):
        """Perform some setup actions."""
        # Initialize input param descriptions
        self.InputParams[0].Description = (
            'This is the x input param.'
        )
        self.InputParams[1].Description = (
            'This is the y input param.'
        )
        # Initialize output param descriptions
        i = 0
        if self.OutputParams[0].Name == 'out':
            i += 1
        self.OutputParams[0+i].Description = (
            'This is the output parameter a, yay!'
        )

    def RunScript(self,
            Pln,
            Members: System.Collections.Generic.List[Rhino.Geometry.GeometryBase]):
        
        d2p_ctype = d2p.ComponentType('ABCD', 'MyPyCompType')
        d2p_comp = d2p.Component(d2p_ctype, 'MyPyComp', Pln)

        d2p_lay = d2p.LayerInfo('MyPyComponentMember', System.Drawing.Color.Red)

        d2p_member = d2p.ComponentMember(d2p_lay, Members)

        d2p_comp.AddMember(d2p_member.NetObj)

        return d2p_comp, d2p_comp.NetObj
# ---------- end py3sdkc ----------
py3 = Python3Script(Pln=pln)  # -> out, d2p_comp; inputs Pln: Plane
# ---------- py3: Python ----------
import System
import Rhino
import rhinoscriptsyntax as rs

import clr
import os
import uuid

try:
    d2p_path = r'C:\Users\EFESTWIN\AppData\Roaming\McNeel\Rhinoceros\packages\8.0\d2p-components\1.1.2\net7.0-windows\D2P_Core.dll'
    d2p_path = os.path.normpath(d2p_path)
    clr.AddReference(d2p_path)
except System.IO.FileLoadException as e:
    print('D2P_Core assembly is already loaded!')

import D2P_Core as d2p


# -------------------------------------------------------

def D2P_CreateComponentType(typeID: str, typeName: str, labelSize: float = 0.0, layerColor: System.Drawing.Color = System.Drawing.Color.Black, settings=None):
    if not settings:
        settings = d2p.Settings()
    if labelSize <= 0:
        labelSize = Rhino.RhinoDoc.ActiveDoc.DimStyles.Current.TextHeight
    componentType = d2p.ComponentType(typeID, typeName, settings, labelSize, layerColor)
    return componentType

def D2P_CreateComponent(componentType: d2p.ComponentType, name: str, plane: Rhino.Geometry.Plane, parent: d2p.Component = None):
    if parent:
        parentName = parent.ShortName
        name = f'{parentName}{componentType.Settings.NameDelimiter}{name}'
    component = d2p.Component(componentType, name, plane)
    return component

d2p_ctype = D2P_CreateComponentType(
    'ABCD',
    'MyCompType',
    0.0
)

d2p_comp = D2P_CreateComponent(d2p_ctype, 'SuperComp', Pln)
# ---------- end py3 ----------
panel = Panel(py3sdkc.NetComp)
panel_2 = Panel(py3sdkc.WrappedComp)
panel_3 = Panel(py3sdkc.out)
