# Grasshopper definition 260304_D2P_CorePy_DevelopmentFile.gh (Grasshopper 1.0.8)
# Copyright: 2025
# plug-ins: d2p-components

# __DEVELOPMENT_CREDITS__: Authors: Max Benjamin Eschenbach
# 
# Digital Design Unit (DDU)
# Prof. Dr.-Ing. Oliver Tessmann
# Fachbereich Architektur
# Technical University of Darmstadt
# 
# CREDITS:
# ------------
py3sdkc = Py3SDKComponent()  # -> out, Beam_A, Beam_B, Joint
# ---------- py3sdkc: Python ----------
#! python3
# -*- coding: utf-8 -*-
# venv: D2P_DEV
print('ENV OK!')
import d2p_core as d2p

# PYTHON STANDARD LIBRARY IMPORTS ---------------------------------------------

# RHINO AND GH RELATED IMPORTS ------------------------------------------------
import System  # type: ignore[reportMissingImport] # NOQA
import Grasshopper  # type: ignore[reportMissingImport] # NOQA
import Rhino  # type: ignore[reportMissingImport] # NOQA
import scriptcontext as sc  # type: ignore[reportMissingImport] # NOQA
import Rhino.Geometry as rg

# GHENV COMPONENT SETTINGS ----------------------------------------------------
ghenv.Component.Name = 'Py3SDKComponent'  # type: ignore[reportUnedfinedVariable] # NOQA
ghenv.Component.NickName = 'Py3SDKC'  # type: ignore[reportUnedfinedVariable] # NOQA
ghenv.Component.Category = 'Maths'  # type: ignore[reportUnedfinedVariable] # NOQA
ghenv.Component.SubCategory = 'Script'  # type: ignore[reportUnedfinedVariable] # NOQA
ghenv.Component.Description = (  # type: ignore[reportUnedfinedVariable] # NOQA
    'This is a Python3 SDK Scriptable Component.'
)


class Py3SDKComponent(Grasshopper.Kernel.GH_ScriptInstance):
    """
    Author: Max Benjamin Eschenbach
    License: MIT License
    Version: 260304
    """

    def __init__(self):
        """Initialize this component and set component parameters."""
        super().__init__()
        # initialize props
        self.Component = ghenv.Component  # type: ignore[reportUnedfinedVariable] # NOQA
        self.InputParams = self.Component.Params.Input
        self.OutputParams = self.Component.Params.Output

    def _addRemark(self, msg: str = ''):
        """Add a remark message to the component."""
        rml = self.Component.RuntimeMessageLevel.Remark
        self.AddRuntimeMessage(rml, msg)

    def _addWarning(self, msg: str = ''):
        """Add a warning message to the component."""
        rml = self.Component.RuntimeMessageLevel.Warning
        self.AddRuntimeMessage(rml, msg)

    def _addError(self, msg: str = ''):
        """Add an error message to the component."""
        rml = self.Component.RuntimeMessageLevel.Error
        self.AddRuntimeMessage(rml, msg)
    

    def RunScript(self):

        # ── Define component types ──
        beam_type = d2p.ComponentType('BM', 'Beam',
            LabelSize=2.5, LayerColor=(60, 120, 200))

        joint_type = d2p.ComponentType('JT', 'Joint',
            LabelSize=1.5, LayerColor=(200, 60, 60))

        # ── Create geometry for beam A1 ──
        pln_a = rg.Plane.WorldXY
        box_a = rg.Box(pln_a, rg.Interval(-50, 50), rg.Interval(-10, 10), rg.Interval(0, 200))
        brep_a = box_a.ToBrep()
        edges_a = [e.DuplicateCurve() for e in brep_a.Edges]

        # ── Create geometry for beam A2 ──
        pln_b = rg.Plane(rg.Point3d(150, 0, 0), rg.Vector3d.ZAxis)
        box_b = rg.Box(pln_b, rg.Interval(-50, 50), rg.Interval(-10, 10), rg.Interval(0, 200))
        brep_b = box_b.ToBrep()
        edges_b = [e.DuplicateCurve() for e in brep_b.Edges]

        # ── Joint geometry (a notch between the two beams) ──
        pln_j = rg.Plane(rg.Point3d(75, 0, 100), rg.Vector3d.ZAxis)
        box_j = rg.Box(pln_j, rg.Interval(-30, 30), rg.Interval(-15, 15), rg.Interval(-20, 20))
        brep_j = box_j.ToBrep()

        # ── Beam A1 ──
        beam_a = d2p.GHComponent(beam_type, 'A1', pln_a)

        body_a = d2p.MemberGeo(beam_a, 'Body', (60, 120, 200))
        body_a.SetObjects([brep_a])

        edge_member_a = d2p.MemberGeo(beam_a, 'Edges', (100, 100, 100))
        edge_member_a.SetObjects(edges_a)

        beam_a.SetMember(body_a)
        beam_a.SetMember(edge_member_a)

        # ── Beam A2 ──
        beam_b = d2p.GHComponent(beam_type, 'A2', pln_b)

        body_b = d2p.MemberGeo(beam_b, 'Body', (60, 120, 200))
        body_b.SetObjects([brep_b])

        edge_member_b = d2p.MemberGeo(beam_b, 'Edges', (100, 100, 100))
        edge_member_b.SetObjects(edges_b)

        beam_b.SetMember(body_b)
        beam_b.SetMember(edge_member_b)

        # ── Joint A1xA2 ──
        joint_name = beam_a.ShortName + d2p.Settings.JointDelimiter + beam_b.ShortName
        joint = d2p.GHComponent(joint_type, joint_name, pln_j)

        cut_geo = d2p.MemberGeo(joint, 'CutGeo', (200, 60, 60))
        cut_geo.SetObjects([brep_j])

        joint.SetMember(cut_geo)

        # ── Output .NET objects to GH wires (no Commit) ──
        return beam_a.NetObj, beam_b.NetObj, joint.NetObj
# ---------- end py3sdkc ----------
# ENVIRONMENT SPEC: #! python3
# # -*- coding: utf-8 -*-
# # venv: D2P_DEV
# print('ENV OK!')
button = Button()
bakecomp = BakeComponents(Components=flatten([py3sdkc.Beam_A, py3sdkc.Beam_B, py3sdkc.Joint]), Bake=button)
panel = Panel(py3sdkc.Beam_B)
panel_2 = Panel(py3sdkc.Beam_A)
panel_3 = Panel(py3sdkc.out)
joints = RetrieveJoints(Component=py3sdkc.Beam_A)
retrieveconnected = RetrieveConnectedComponents(Component=joints)
